# Grasshopper definition Test.gh (Grasshopper 1.0.7)
# plug-ins: HVACEarlyDesignGraphRewritting

panel = Panel("""OfficeBuilding1_Arm_Lower_Left_Floor_1_38fce418
OfficeBuilding1_Arm_Lower_Left_Floor_2_01def439
OfficeBuilding1_Arm_Lower_Left_Floor_3_1f7ddf80
OfficeBuilding1_Arm_Lower_Left_Floor_4_de06524b
OfficeBuilding1_Arm_Lower_Right_Floor_1_7da0fc34
OfficeBuilding1_Arm_Lower_Right_Floor_2_4090f223
OfficeBuilding1_Arm_Lower_Right_Floor_3_ea9edb99
OfficeBuilding1_Arm_Lower_Right_Floor_4_0b07a85f
OfficeBuilding1_Arm_Upper_Left_Floor_1_93495656
OfficeBuilding1_Arm_Upper_Left_Floor_2_472ff17f
OfficeBuilding1_Arm_Upper_Left_Floor_3_8d719eb2
OfficeBuilding1_Arm_Upper_Left_Floor_4_bc30d852
OfficeBuilding1_Arm_Upper_Right_Floor_1_2f5608f0
OfficeBuilding1_Arm_Upper_Right_Floor_2_9aa42a56
OfficeBuilding1_Arm_Upper_Right_Floor_3_6b1974dc
OfficeBuilding1_Arm_Upper_Right_Floor_4_3c31bbad
OfficeBuilding1_Center_Left_Floor_1_80061b12
OfficeBuilding1_Center_Left_Floor_2_6d400162
OfficeBuilding1_Center_Left_Floor_3_d88e6153
OfficeBuilding1_Center_Left_Floor_4_82fd5061
OfficeBuilding1_Center_Lower_Floor_1_cbc223e5
OfficeBuilding1_Center_Lower_Floor_2_62cc9f65
OfficeBuilding1_Center_Lower_Floor_3_12ada1e4
OfficeBuilding1_Center_Lower_Floor_4_9416e6bb
OfficeBuilding1_Center_Right_Floor_1_b3fd8739
OfficeBuilding1_Center_Right_Floor_2_c5340818
OfficeBuilding1_Center_Right_Floor_3_cbe4e04b
OfficeBuilding1_Center_Right_Floor_4_38fba3a2
OfficeBuilding1_Center_Upper_Floor_1_34900490
OfficeBuilding1_Center_Upper_Floor_2_e7efc055
OfficeBuilding1_Center_Upper_Floor_3_67329303
OfficeBuilding1_Center_Upper_Floor_4_755dab8f
OfficeBuilding1_Core_Floor_1_67be9211
OfficeBuilding1_Core_Floor_2_8afa4821
OfficeBuilding1_Core_Floor_3_e4789845
OfficeBuilding1_Core_Floor_4_30577553""")
nickname = ZoneNode(Name="HVACRoom", AreaHVAC=Slider(10, range=0..10))
nickname_2 = Graph()  # -> Graph, Actions, ProcessingEnvironment
nickname_3 = Graph()  # -> Graph, Actions, ProcessingEnvironment
nickname_4 = ZoneNode(Name=panel, AreaHVAC=Slider(0, range=0..100))
merge = Merge(Data1=nickname_4, Data2=nickname)
nickname_5 = AddNode(ProcessingEnvironment=nickname_3.ProcessingEnvironment, Node=merge)
nickname_6 = Rewrite(ProcessingEnvironment=nickname_3.ProcessingEnvironment, RewriteSequence="BoilerPlacement && RadiatorPlacement*")
panel_2 = Panel(nickname_3.Graph)
nickname_7 = ShowGraph(Graph=nickname_3.Graph)
